# Grasshopper definition kit_of_parts.gh (Grasshopper 1.0.7)

brep = Brep(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)
brep_2 = Brep([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])
brep_3 = Brep([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])

brep_4 = Brep(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)
brep_5 = Brep([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])
brep_6 = Brep([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])

brep_7 = Brep(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)
brep_8 = Brep([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])
brep_9 = Brep([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])

brep_10 = Brep(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)
brep_11 = Brep([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])
brep_12 = Brep([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])
brep_13 = Brep(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)
brep_14 = Brep(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)
brep_15 = Brep(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)

brep_16 = Brep(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)
brep_17 = Brep([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])
brep_18 = Brep([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])

brep_19 = Brep([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])
brep_20 = Brep([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])
brep_21 = Brep([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])
brep_22 = Brep([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])

brep_23 = Brep(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)
brep_24 = Brep([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])
brep_25 = Brep([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])

brep_26 = Brep([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])
brep_27 = Brep([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])
brep_28 = Brep([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])
brep_29 = Brep([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])

mesh_brep = MeshBrep(
    Brep=brep_15,
    Settings={GridMaxCount=0, GridMinCount=16, JaggedSeams=False, MaxEdgeLength=0, MinEdgeLength=0.0001, MinTolerance=0, Refine=True, RefineAngle=0, RelativeTolerance=0.65, SimplePlanes=True, Tolerance=0})
mesh_brep_2 = MeshBrep(
    Brep=brep_14,
    Settings={GridMaxCount=0, GridMinCount=16, JaggedSeams=False, MaxEdgeLength=0, MinEdgeLength=0.0001, MinTolerance=0, Refine=True, RefineAngle=0, RelativeTolerance=0.65, SimplePlanes=True, Tolerance=0})
mesh_brep_3 = MeshBrep(
    Brep=brep_13,
    Settings={GridMaxCount=0, GridMinCount=16, JaggedSeams=False, MaxEdgeLength=0, MinEdgeLength=0.0001, MinTolerance=0, Refine=True, RefineAngle=0, RelativeTolerance=0.65, SimplePlanes=True, Tolerance=0})
mesh_brep_4 = MeshBrep(
    Brep=brep_12,
    Settings={GridMaxCount=0, GridMinCount=16, JaggedSeams=False, MaxEdgeLength=0, MinEdgeLength=0.0001, MinTolerance=0, Refine=True, RefineAngle=0, RelativeTolerance=0.65, SimplePlanes=True, Tolerance=0})
mesh_brep_5 = MeshBrep(
    Brep=brep_11,
    Settings={GridMaxCount=0, GridMinCount=16, JaggedSeams=False, MaxEdgeLength=0, MinEdgeLength=0.0001, MinTolerance=0, Refine=True, RefineAngle=0, RelativeTolerance=0.65, SimplePlanes=True, Tolerance=0})
mesh_brep_6 = MeshBrep(
    Brep=brep_10,
    Settings={GridMaxCount=0, GridMinCount=16, JaggedSeams=False, MaxEdgeLength=0, MinEdgeLength=0.0001, MinTolerance=0, Refine=True, RefineAngle=0, RelativeTolerance=0.65, SimplePlanes=True, Tolerance=0})
mesh_brep_7 = MeshBrep(
    Brep=brep_18,
    Settings={GridMaxCount=0, GridMinCount=16, JaggedSeams=False, MaxEdgeLength=0, MinEdgeLength=0.0001, MinTolerance=0, Refine=True, RefineAngle=0, RelativeTolerance=0.65, SimplePlanes=True, Tolerance=0})
mesh_brep_8 = MeshBrep(
    Brep=brep_17,
    Settings={GridMaxCount=0, GridMinCount=16, JaggedSeams=False, MaxEdgeLength=0, MinEdgeLength=0.0001, MinTolerance=0, Refine=True, RefineAngle=0, RelativeTolerance=0.65, SimplePlanes=True, Tolerance=0})
mesh_brep_9 = MeshBrep(
    Brep=brep_19,
    Settings={GridMaxCount=0, GridMinCount=16, JaggedSeams=False, MaxEdgeLength=0, MinEdgeLength=0.0001, MinTolerance=0, Refine=True, RefineAngle=0, RelativeTolerance=0.65, SimplePlanes=True, Tolerance=0})
mesh_brep_10 = MeshBrep(
    Brep=brep_21,
    Settings={GridMaxCount=0, GridMinCount=16, JaggedSeams=False, MaxEdgeLength=0, MinEdgeLength=0.0001, MinTolerance=0, Refine=True, RefineAngle=0, RelativeTolerance=0.65, SimplePlanes=True, Tolerance=0})
mesh_brep_11 = MeshBrep(
    Brep=brep_16,
    Settings={GridMaxCount=0, GridMinCount=16, JaggedSeams=False, MaxEdgeLength=0, MinEdgeLength=0.0001, MinTolerance=0, Refine=True, RefineAngle=0, RelativeTolerance=0.65, SimplePlanes=True, Tolerance=0})
mesh_brep_12 = MeshBrep(
    Brep=brep_20,
    Settings={GridMaxCount=0, GridMinCount=16, JaggedSeams=False, MaxEdgeLength=0, MinEdgeLength=0.0001, MinTolerance=0, Refine=True, RefineAngle=0, RelativeTolerance=0.65, SimplePlanes=True, Tolerance=0})
mesh_brep_13 = MeshBrep(
    Brep=brep_22,
    Settings={GridMaxCount=0, GridMinCount=16, JaggedSeams=False, MaxEdgeLength=0, MinEdgeLength=0.0001, MinTolerance=0, Refine=True, RefineAngle=0, RelativeTolerance=0.65, SimplePlanes=True, Tolerance=0})
mesh_brep_14 = MeshBrep(
    Brep=brep_24,
    Settings={GridMaxCount=0, GridMinCount=16, JaggedSeams=False, MaxEdgeLength=0, MinEdgeLength=0.0001, MinTolerance=0, Refine=True, RefineAngle=0, RelativeTolerance=0.65, SimplePlanes=True, Tolerance=0})
mesh_brep_15 = MeshBrep(
    Brep=brep_25,
    Settings={GridMaxCount=0, GridMinCount=16, JaggedSeams=False, MaxEdgeLength=0, MinEdgeLength=0.0001, MinTolerance=0, Refine=True, RefineAngle=0, RelativeTolerance=0.65, SimplePlanes=True, Tolerance=0})
mesh_brep_16 = MeshBrep(
    Brep=brep_23,
    Settings={GridMaxCount=0, GridMinCount=16, JaggedSeams=False, MaxEdgeLength=0, MinEdgeLength=0.0001, MinTolerance=0, Refine=True, RefineAngle=0, RelativeTolerance=0.65, SimplePlanes=True, Tolerance=0})
mesh_brep_17 = MeshBrep(
    Brep=brep_29,
    Settings={GridMaxCount=0, GridMinCount=16, JaggedSeams=False, MaxEdgeLength=0, MinEdgeLength=0.0001, MinTolerance=0, Refine=True, RefineAngle=0, RelativeTolerance=0.65, SimplePlanes=True, Tolerance=0})
mesh_brep_18 = MeshBrep(
    Brep=brep_28,
    Settings={GridMaxCount=0, GridMinCount=16, JaggedSeams=False, MaxEdgeLength=0, MinEdgeLength=0.0001, MinTolerance=0, Refine=True, RefineAngle=0, RelativeTolerance=0.65, SimplePlanes=True, Tolerance=0})
mesh_brep_19 = MeshBrep(
    Brep=brep_27,
    Settings={GridMaxCount=0, GridMinCount=16, JaggedSeams=False, MaxEdgeLength=0, MinEdgeLength=0.0001, MinTolerance=0, Refine=True, RefineAngle=0, RelativeTolerance=0.65, SimplePlanes=True, Tolerance=0})
mesh_brep_20 = MeshBrep(
    Brep=brep_26,
    Settings={GridMaxCount=0, GridMinCount=16, JaggedSeams=False, MaxEdgeLength=0, MinEdgeLength=0.0001, MinTolerance=0, Refine=True, RefineAngle=0, RelativeTolerance=0.65, SimplePlanes=True, Tolerance=0})
boolean_toggle = BooleanToggle(True)
mesh_join = MeshJoin(Meshes=mesh_brep_4)
mesh_join_2 = MeshJoin(Meshes=[mesh_brep_6, mesh_brep_5])
number_slider = Slider(1, range=0..1)

mesh_brep_21 = MeshBrep(
    Brep=brep_3,
    Settings={GridMaxCount=0, GridMinCount=16, JaggedSeams=False, MaxEdgeLength=0, MinEdgeLength=0.0001, MinTolerance=0, Refine=True, RefineAngle=0, RelativeTolerance=0.65, SimplePlanes=True, Tolerance=0})
mesh_brep_22 = MeshBrep(
    Brep=brep_2,
    Settings={GridMaxCount=0, GridMinCount=16, JaggedSeams=False, MaxEdgeLength=0, MinEdgeLength=0.0001, MinTolerance=0, Refine=True, RefineAngle=0, RelativeTolerance=0.65, SimplePlanes=True, Tolerance=0})
mesh_brep_23 = MeshBrep(
    Brep=brep,
    Settings={GridMaxCount=0, GridMinCount=16, JaggedSeams=False, MaxEdgeLength=0, MinEdgeLength=0.0001, MinTolerance=0, Refine=True, RefineAngle=0, RelativeTolerance=0.65, SimplePlanes=True, Tolerance=0})
mesh_brep_24 = MeshBrep(
    Brep=brep_8,
    Settings={GridMaxCount=0, GridMinCount=16, JaggedSeams=False, MaxEdgeLength=0, MinEdgeLength=0.0001, MinTolerance=0, Refine=True, RefineAngle=0, RelativeTolerance=0.65, SimplePlanes=True, Tolerance=0})
mesh_brep_25 = MeshBrep(
    Brep=brep_6,
    Settings={GridMaxCount=0, GridMinCount=16, JaggedSeams=False, MaxEdgeLength=0, MinEdgeLength=0.0001, MinTolerance=0, Refine=True, RefineAngle=0, RelativeTolerance=0.65, SimplePlanes=True, Tolerance=0})
mesh_brep_26 = MeshBrep(
    Brep=brep_9,
    Settings={GridMaxCount=0, GridMinCount=16, JaggedSeams=False, MaxEdgeLength=0, MinEdgeLength=0.0001, MinTolerance=0, Refine=True, RefineAngle=0, RelativeTolerance=0.65, SimplePlanes=True, Tolerance=0})
mesh_brep_27 = MeshBrep(
    Brep=brep_5,
    Settings={GridMaxCount=0, GridMinCount=16, JaggedSeams=False, MaxEdgeLength=0, MinEdgeLength=0.0001, MinTolerance=0, Refine=True, RefineAngle=0, RelativeTolerance=0.65, SimplePlanes=True, Tolerance=0})
simple_mesh = SimpleMesh(Brep=brep_7)
mesh_brep_28 = MeshBrep(
    Brep=brep_4,
    Settings={GridMaxCount=0, GridMinCount=16, JaggedSeams=False, MaxEdgeLength=0, MinEdgeLength=0.0001, MinTolerance=0, Refine=True, RefineAngle=0, RelativeTolerance=0.65, SimplePlanes=True, Tolerance=0})
mesh_join_3 = MeshJoin(Meshes=mesh_brep_21)
mesh_join_4 = MeshJoin(Meshes=mesh_brep_22)
mesh_join_5 = MeshJoin(Meshes=mesh_brep_25)
mesh_join_6 = MeshJoin(Meshes=mesh_brep_27)
mesh_join_7 = MeshJoin(Meshes=mesh_brep_24)
mesh_join_8 = MeshJoin(Meshes=mesh_brep_26)
boolean_toggle_2 = BooleanToggle(True)
brep_30 = Brep(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)
boolean_toggle_3 = BooleanToggle(True)
boolean_toggle_4 = BooleanToggle(True)
simple_mesh_2 = SimpleMesh(Brep=brep_30)
attribute = Wasp_Attribute(ID="floor", VAL=mesh_brep_23, TR=boolean_toggle_2)  # -> ATTR; inputs VAL: list, TR: Boolean; plug-in component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
attribute_2 = Wasp_Attribute(ID="arches", VAL=mesh_join_3, TR=boolean_toggle_2)  # -> ATTR; inputs VAL: list, TR: Boolean; plug-in component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
attribute_3 = Wasp_Attribute(ID="railing", VAL=mesh_join_4, TR=boolean_toggle_2)  # -> ATTR; inputs VAL: list, TR: Boolean; plug-in component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
attribute_4 = Wasp_Attribute(ID="floor", VAL=mesh_brep_28, TR=boolean_toggle_3)  # -> ATTR; inputs VAL: list, TR: Boolean; plug-in component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
attribute_5 = Wasp_Attribute(ID="railing", VAL=mesh_join_6, TR=boolean_toggle_3)  # -> ATTR; inputs VAL: list, TR: Boolean; plug-in component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
attribute_6 = Wasp_Attribute(ID="arches", VAL=mesh_join_5, TR=boolean_toggle_3)  # -> ATTR; inputs VAL: list, TR: Boolean; plug-in component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
attribute_7 = Wasp_Attribute(ID="floor", VAL=simple_mesh, TR=boolean_toggle_4)  # -> ATTR; inputs VAL: list, TR: Boolean; plug-in component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
attribute_8 = Wasp_Attribute(ID="railing", VAL=mesh_join_7, TR=boolean_toggle_4)  # -> ATTR; inputs VAL: list, TR: Boolean; plug-in component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
attribute_9 = Wasp_Attribute(ID="arches", VAL=mesh_join_8, TR=boolean_toggle_4)  # -> ATTR; inputs VAL: list, TR: Boolean; plug-in component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
geometry = Geometry(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)
geometry_2 = Geometry(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)
curve = Curve([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])
point = Point([Point(-25, 27.5, 1.5), Point(-16, 24.5, 1.575)])
curve_2 = Curve([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])
point_2 = Point([Point(-41.5, 23, 1.5), Point(-46, 27.5, 1.5)])
geometry_3 = Geometry(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)
curve_3 = Curve([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])
point_3 = Point([Point(-32.5, 26, 1.5), Point(-34, 24.5, 1.5), Point(-32.5, 23, 1.5), Point(-31, 24.5, 1.5)])
geometry_4 = Geometry(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)
point_4 = Point([Point(-10, 24.5, 1.5), Point(-4, 24.5, 1.5)])
curve_4 = Curve([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])
attribute_10 = Wasp_Attribute(ID="floor", VAL=simple_mesh_2, TR=Toggle(True))  # -> ATTR; inputs VAL: list, TR: Boolean; plug-in component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
point_list = PointList(Points=point, Size=number_slider)
point_list_2 = PointList(Points=point_2, Size=number_slider)
point_list_3 = PointList(Points=point_3, Size=number_slider)
point_list_4 = PointList(Points=point_4, Size=number_slider)
panel = Panel("""B
B""")
panel_2 = Panel("""A
A""")
panel_3 = Panel("""A
A
A
A""")
panel_4 = Panel("""B
B""")
conndir = Wasp_ConnectionFromDirection(GEO=geometry, CEN=point, UP=curve, T=panel)  # -> CONN, PLN_OUT; inputs CEN: list of Point3d, UP: list of Curve, T: list; plug-in component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
conndir_2 = Wasp_ConnectionFromDirection(GEO=geometry_2, CEN=point_2, UP=curve_2, T=panel_2)  # -> CONN, PLN_OUT; inputs CEN: list of Point3d, UP: list of Curve, T: list; plug-in component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
conndir_3 = Wasp_ConnectionFromDirection(GEO=geometry_3, CEN=point_3, UP=curve_3, T=panel_3)  # -> CONN, PLN_OUT; inputs CEN: list of Point3d, UP: list of Curve, T: list; plug-in component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
conndir_4 = Wasp_ConnectionFromDirection(GEO=geometry_4, CEN=point_4, UP=curve_4, T=panel_4)  # -> CONN, PLN_OUT; inputs CEN: list of Point3d, UP: list of Curve, T: list; plug-in component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
advpart = Wasp_AdvancedPart(NAME="corridor2", GEO=geometry, CONN=flatten(conndir.CONN), ATTR=[attribute_4, attribute_5, attribute_6])  # -> PART; inputs GEO: Mesh, CONN: list, HI: list, ATTR: list, SUP: list, AEC: list, OC: list; plug-in component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
advpart_2 = Wasp_AdvancedPart(NAME="corridor4", GEO=geometry_2, CONN=flatten(conndir_2.CONN), ATTR=[attribute, attribute_3, attribute_2])  # -> PART; inputs GEO: Mesh, CONN: list, HI: list, ATTR: list, SUP: list, AEC: list, OC: list; plug-in component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
advpart_3 = Wasp_AdvancedPart(NAME="corridor", GEO=geometry_4, CONN=flatten(conndir_4.CONN), ATTR=[attribute_7, attribute_8, attribute_9])  # -> PART; inputs GEO: Mesh, CONN: list, HI: list, ATTR: list, SUP: list, AEC: list, OC: list; plug-in component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
advpart_4 = Wasp_AdvancedPart(NAME="corridor3", GEO=geometry_3, CONN=flatten(conndir_3.CONN), ATTR=attribute_10)  # -> PART; inputs GEO: Mesh, CONN: list, HI: list, ATTR: list, SUP: list, AEC: list, OC: list; plug-in component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

mesh_join_9 = MeshJoin(Meshes=mesh_brep_7)
mesh_join_10 = MeshJoin(Meshes=mesh_brep_9)
mesh_join_11 = MeshJoin(Meshes=mesh_brep_10)
mesh_join_12 = MeshJoin(Meshes=mesh_brep_8)
mesh_join_13 = MeshJoin(Meshes=mesh_brep_11)
mesh_join_14 = MeshJoin(Meshes=mesh_brep_12)
mesh_join_15 = MeshJoin(Meshes=mesh_brep_13)
mesh_join_16 = MeshJoin(Meshes=mesh_brep_14)
mesh_join_17 = MeshJoin(Meshes=mesh_brep_15)
mesh_join_18 = MeshJoin(Meshes=mesh_brep_16)
boolean_toggle_5 = BooleanToggle(True)
mesh_join_19 = MeshJoin(Meshes=mesh_brep_17)
mesh_join_20 = MeshJoin(Meshes=mesh_brep_18)
mesh_join_21 = MeshJoin(Meshes=mesh_brep_19)
mesh_join_22 = MeshJoin(Meshes=mesh_brep_20)
boolean_toggle_6 = BooleanToggle(True)
boolean_toggle_7 = BooleanToggle(True)
boolean_toggle_8 = BooleanToggle(True)
attribute_11 = Wasp_Attribute(ID="railing", VAL=mesh_brep, TR=boolean_toggle)  # -> ATTR; inputs VAL: list, TR: Boolean; plug-in component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
attribute_12 = Wasp_Attribute(ID="glass", VAL=mesh_brep_2, TR=boolean_toggle)  # -> ATTR; inputs VAL: list, TR: Boolean; plug-in component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
attribute_13 = Wasp_Attribute(ID="arches", VAL=mesh_join, TR=boolean_toggle)  # -> ATTR; inputs VAL: list, TR: Boolean; plug-in component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
attribute_14 = Wasp_Attribute(ID="floor", VAL=mesh_brep_3, TR=boolean_toggle)  # -> ATTR; inputs VAL: list, TR: Boolean; plug-in component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
attribute_15 = Wasp_Attribute(ID="body", VAL=mesh_join_2, TR=boolean_toggle)  # -> ATTR; inputs VAL: list, TR: Boolean; plug-in component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
attribute_16 = Wasp_Attribute(ID="body", VAL=mesh_join_15, TR=boolean_toggle_6)  # -> ATTR; inputs VAL: list, TR: Boolean; plug-in component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
attribute_17 = Wasp_Attribute(ID="arches", VAL=mesh_join_12, TR=boolean_toggle_7)  # -> ATTR; inputs VAL: list, TR: Boolean; plug-in component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
attribute_18 = Wasp_Attribute(ID="body", VAL=mesh_join_13, TR=boolean_toggle_7)  # -> ATTR; inputs VAL: list, TR: Boolean; plug-in component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
attribute_19 = Wasp_Attribute(ID="glass", VAL=mesh_join_14, TR=boolean_toggle_6)  # -> ATTR; inputs VAL: list, TR: Boolean; plug-in component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
attribute_20 = Wasp_Attribute(ID="railing", VAL=mesh_join_10, TR=boolean_toggle_6)  # -> ATTR; inputs VAL: list, TR: Boolean; plug-in component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
attribute_21 = Wasp_Attribute(ID="glass", VAL=mesh_join_12, TR=boolean_toggle_7)  # -> ATTR; inputs VAL: list, TR: Boolean; plug-in component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
attribute_22 = Wasp_Attribute(ID="arches", VAL=mesh_join_11, TR=boolean_toggle_6)  # -> ATTR; inputs VAL: list, TR: Boolean; plug-in component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
attribute_23 = Wasp_Attribute(ID="railing", VAL=mesh_join_21, TR=boolean_toggle_5)  # -> ATTR; inputs VAL: list, TR: Boolean; plug-in component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
attribute_24 = Wasp_Attribute(ID="arches", VAL=mesh_join_20, TR=boolean_toggle_5)  # -> ATTR; inputs VAL: list, TR: Boolean; plug-in component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
attribute_25 = Wasp_Attribute(ID="floor", VAL=mesh_join_22, TR=boolean_toggle_5)  # -> ATTR; inputs VAL: list, TR: Boolean; plug-in component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
attribute_26 = Wasp_Attribute(ID="glass", VAL=mesh_join_19, TR=boolean_toggle_5)  # -> ATTR; inputs VAL: list, TR: Boolean; plug-in component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
attribute_27 = Wasp_Attribute(ID="floor", VAL=mesh_join_18, TR=boolean_toggle_8)  # -> ATTR; inputs VAL: list, TR: Boolean; plug-in component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
attribute_28 = Wasp_Attribute(ID="railing", VAL=mesh_join_17, TR=boolean_toggle_8)  # -> ATTR; inputs VAL: list, TR: Boolean; plug-in component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
attribute_29 = Wasp_Attribute(ID="arches", VAL=mesh_join_16, TR=boolean_toggle_8)  # -> ATTR; inputs VAL: list, TR: Boolean; plug-in component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
geometry_5 = Geometry(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)
point_5 = Point(Point(19.5, 42, 1.5))
curve_5 = Curve(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)
geometry_6 = Geometry(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)
geometry_7 = Geometry(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)
point_6 = Point(Point(3, 24.5, 1.25))
curve_6 = Curve(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)
point_7 = Point(Point(15, 24.5, 1.5))
curve_7 = Curve(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)
geometry_8 = Geometry(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)
curve_8 = Curve([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])
point_8 = Point([Point(39, 24.5, 1.5), Point(52.5, 23, 4.5), Point(54, 24.5, 4.5), Point(52.5, 26, 4.5)])
geometry_9 = Geometry(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)
curve_9 = Curve([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])
point_9 = Point([Point(27, 24.5, 1.5), Point(27, 24.5, 4.5)])
curve_10 = Curve([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])
point_10 = Point([Point(31.5, 24.5, 0), Point(31.5, 24.5, 6)])
point_list_5 = PointList(Points=point_5, Size=number_slider)
point_list_6 = PointList(Points=point_6, Size=number_slider)
point_list_7 = PointList(Points=point_7, Size=number_slider)
point_list_8 = PointList(Points=point_8, Size=number_slider)
point_list_9 = PointList(Points=point_9, Size=number_slider)
point_list_10 = PointList(Points=point_10, Size=number_slider)
panel_5 = Panel("""A
B
B
B""")
panel_6 = Panel("""A
A""")
panel_7 = Panel("""C
D""")
conndir_5 = Wasp_ConnectionFromDirection(GEO=geometry_5, CEN=point_5, UP=curve_5, T="B")  # -> CONN, PLN_OUT; inputs CEN: list of Point3d, UP: list of Curve, T: list; plug-in component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
conndir_6 = Wasp_ConnectionFromDirection(GEO=geometry_6, CEN=point_6, UP=curve_6, T="B")  # -> CONN, PLN_OUT; inputs CEN: list of Point3d, UP: list of Curve, T: list; plug-in component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
conndir_7 = Wasp_ConnectionFromDirection(GEO=geometry_7, CEN=point_7, UP=curve_7, T="B")  # -> CONN, PLN_OUT; inputs CEN: list of Point3d, UP: list of Curve, T: list; plug-in component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
conndir_8 = Wasp_ConnectionFromDirection(GEO=geometry_8, CEN=point_8, UP=curve_8, T=panel_5)  # -> CONN, PLN_OUT; inputs CEN: list of Point3d, UP: list of Curve, T: list; plug-in component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
conndir_9 = Wasp_ConnectionFromDirection(GEO=geometry_9, CEN=point_9, UP=curve_9, T=panel_6)  # -> CONN, PLN_OUT; inputs CEN: list of Point3d, UP: list of Curve, T: list; plug-in component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
conndir_10 = Wasp_ConnectionFromDirection(GEO=geometry_9, CEN=point_10, UP=curve_10, T=panel_7)  # -> CONN, PLN_OUT; inputs CEN: list of Point3d, UP: list of Curve, T: list; plug-in component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
advpart_5 = Wasp_AdvancedPart(
    NAME="office",
    GEO=geometry_5,
    CONN=flatten(conndir_5.CONN),
    ATTR=[attribute_15, attribute_13, attribute_14, attribute_12, attribute_11])  # -> PART; inputs GEO: Mesh, CONN: list, HI: list, ATTR: list, SUP: list, AEC: list, OC: list; plug-in component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
advpart_6 = Wasp_AdvancedPart(NAME="lab", GEO=geometry_6, CONN=flatten(conndir_6.CONN), ATTR=[attribute_18, attribute_17, attribute_21])  # -> PART; inputs GEO: Mesh, CONN: list, HI: list, ATTR: list, SUP: list, AEC: list, OC: list; plug-in component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
advpart_7 = Wasp_AdvancedPart(
    NAME="aprmnt",
    GEO=geometry_7,
    CONN=flatten(conndir_7.CONN),
    ATTR=[attribute_16, attribute_19, attribute_22, attribute_20])  # -> PART; inputs GEO: Mesh, CONN: list, HI: list, ATTR: list, SUP: list, AEC: list, OC: list; plug-in component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
advpart_8 = Wasp_AdvancedPart(NAME="ramp", GEO=geometry_8, CONN=flatten(conndir_8.CONN), ATTR=[attribute_27, attribute_28, attribute_29])  # -> PART; inputs GEO: Mesh, CONN: list, HI: list, ATTR: list, SUP: list, AEC: list, OC: list; plug-in component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
advpart_9 = Wasp_AdvancedPart(
    NAME="elevator",
    GEO=geometry_9,
    CONN=flatten([conndir_9.CONN, conndir_10.CONN]),
    ATTR=[attribute_25, attribute_23, attribute_24, attribute_26])  # -> PART; inputs GEO: Mesh, CONN: list, HI: list, ATTR: list, SUP: list, AEC: list, OC: list; plug-in component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
merge = Merge(Data1=advpart_9, Data2=advpart_8, Data3=advpart_6, Data4=advpart_7, Data5=advpart_5)
merge_2 = Merge(Data1=advpart_3, Data2=advpart, Data3=advpart_4, Data4=advpart_2)
merge_3 = Merge(Data1=merge_2, Data2=merge)

sitelength = GetInteger(Slider(83, range=0..100), AtLeast=1, AtMost=1, Maximum=2147483647, Minimum=-2147483648, Prompt="0 to 100")
sitebreadth = GetInteger(Slider(80, range=0..100), AtLeast=1, AtMost=1, Maximum=2147483647, Minimum=-2147483648, Prompt="0 to 100")
siteheight = GetInteger(Slider(43, range=0..100), AtLeast=1, AtMost=1, Maximum=2147483647, Minimum=-2147483648, Prompt="0 to 100")
negative = Negative(Value=sitebreadth)
negative_2 = Negative(Value=sitelength)
construct_point = ConstructPoint(XCoordinate="0", YCoordinate="0", ZCoordinate="0")
construct_domain = ConstructDomain(DomainStart=negative_2, DomainEnd=sitelength)
construct_domain_2 = ConstructDomain(DomainStart=negative, DomainEnd=sitebreadth)
xy_plane = XYPlane(Origin=construct_point)
value_list = ValueList({"x-axis": 0, "y-axis": 1, "z-axis": 2}, selected="x-axis")
value_list_2 = ValueList({"One": 0, "Two": 1, "Three": 2}, selected="Two")
domain_box = DomainBox(Base=xy_plane, X=construct_domain, Y=construct_domain_2, Z=siteheight)
volume = Volume(Geometry=domain_box)  # -> Volume, Centroid
xyzaxis = GetInteger(Slider(0, range=0..2), AtLeast=1, AtMost=1, Maximum=2147483647, Minimum=-2147483648, Prompt="0,1 & 2")
fieldpts = Wasp_FieldPoints(BOU=domain_box, RES=Slider(9.9, range=0..10))  # -> E_FIELD, PTS; inputs BOU: list of Mesh, PLN: Plane; plug-in component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
shiftsides = GetInteger(Slider(2, range=0..2), AtLeast=1, AtMost=1, Maximum=2147483647, Minimum=-2147483648, Prompt="0,1 & 2")
point_11 = Point(fieldpts.PTS)
deconstruct = Deconstruct(Point=point_11)  # -> XComponent, YComponent, ZComponent
pull_point = PullPoint(Point=point_11, Geometry=volume.Centroid, ClosestOnly=True)  # -> ClosestPoint, Distance
stream_filter = StreamFilter(Gate=xyzaxis, Stream0=deconstruct.XComponent, Stream1=deconstruct.YComponent, Stream2=deconstruct.ZComponent)
bounds = Bounds(Numbers=stream_filter)
bounds_2 = Bounds(Numbers=stream_filter)
bounds_3 = Bounds(Numbers=pull_point.Distance)
construct_domain_3 = ConstructDomain(DomainStart=Slider(0, range=0..1), DomainEnd=Slider(1, range=0..1))
remap_numbers = RemapNumbers(Value=stream_filter, Source=bounds, Target="0 to 1")  # -> Mapped, Clipped
remap_numbers_2 = RemapNumbers(Value=stream_filter, Source=bounds_2, Target="1 to 0")  # -> Mapped, Clipped
remap_numbers_3 = RemapNumbers(Value=pull_point.Distance, Source=bounds_3, Target=construct_domain_3)  # -> Mapped, Clipped
graph_mapper = GraphMapper(
    remap_numbers_3.Mapped,
    x0=0,
    x1=1,
    y0=0,
    y1=1,
    container_name="Bezier",
    cpx=[0, 0.9869508743, 0.01401508693, 1],
    cpy=[0, 0, 1, 1])
multiplication = Multiplication(A=graph_mapper, B=remap_numbers.Mapped)
multiplication_2 = Multiplication(A=graph_mapper, B=remap_numbers_2.Mapped)
stream_filter_2 = StreamFilter(Gate=shiftsides, Stream0=graph_mapper, Stream1=multiplication, Stream2=multiplication_2)
gradient = Gradient(
    LowerLimit=0,
    UpperLimit=1,
    Parameter=stream_filter_2,
    stops=[0: RGB(0, 128, 0), 0.5: RGB(255, 255, 0), 1: RGB(255, 0, 0)])
custom_preview = CustomPreview(Geometry=point_11, Material=gradient)

panel_8 = Panel("""A>B
B>A
C>D""")
rulegen = Wasp_RulesGenerator(PART=merge_3, GR=panel_8)  # -> R; inputs PART: list, SELF_P: Boolean, SELF_C: Boolean, TYP: Boolean, GR: list; plug-in component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
numberofparts = GetInteger(Slider(153, range=0..1000), AtLeast=1, AtMost=1, Maximum=2147483647, Minimum=-2147483648, Prompt="0 to 100")
multiplication_3 = Multiplication(A=Slider(0.1, range=0..1), B=numberofparts)
multiplication_4 = Multiplication(A=Slider(0.1, range=0..1), B=numberofparts)
multiplication_5 = Multiplication(A=Slider(0.1, range=0..1), B=numberofparts)
multiplication_6 = Multiplication(A=Slider(0.1, range=0..1), B=numberofparts)
multiplication_7 = Multiplication(A=Slider(0.1, range=0..1), B=numberofparts)
multiplication_8 = Multiplication(A=Slider(0.1, range=0..1), B=numberofparts)
multiplication_9 = Multiplication(A=Slider(0.1, range=0..1), B=numberofparts)
multiplication_10 = Multiplication(A=Slider(0.1, range=0..1), B=numberofparts)
multiplication_11 = Multiplication(A=Slider(0.1, range=0..1), B=numberofparts)
integer = Integer(multiplication_4)
integer_2 = Integer(multiplication_6)
integer_3 = Integer(multiplication_3)
integer_4 = Integer(multiplication_11)
integer_5 = Integer(multiplication_7)
integer_6 = Integer(multiplication_8)
integer_7 = Integer(multiplication_9)
integer_8 = Integer(multiplication_5)
integer_9 = Integer(multiplication_10)
merge_4 = Merge(
    Data1=integer_2,
    Data2=integer,
    Data3=integer_4,
    Data4=integer_3,
    Data5=integer_5,
    Data7=integer_6,
    Data8=integer_7,
    Data9=integer_8,
    Data10=integer_9)
partcat = Wasp_PartsCatalog(PART=flatten(merge_3), NUM=merge_4)  # -> CAT; inputs PART: list, NUM: list, LIM: Boolean, AD: Boolean; plug-in component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
mass_addition = MassAddition(Input=merge_4)  # -> Result, PartialResults
panel_9 = Panel(partcat)
field = Wasp_Field(NAME="f1", E_FIELD=fieldpts.E_FIELD, VAL=stream_filter_2)  # -> FIELD; inputs VAL: list; plug-in component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
fieldaggregation = Wasp_FieldDrivenAggregation(PART=flatten(merge_3), N=numberofparts, RULES=rulegen, FIELD=field, CAT=partcat, MODE=0, RESET=Button())  # -> AGGR, PART_OUT; inputs PART: list, PREV: list, N: Int32, RULES: list, FIELD: list, MODE: Int32, GC: list, RESET: Boolean; plug-in component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
namefilter = Wasp_FilterPartsByName(PART=fieldaggregation.PART_OUT, NAME="corridor")  # -> PART_OUT, MASK; inputs PART: list, NAME: list; plug-in component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
namefilter_2 = Wasp_FilterPartsByName(PART=fieldaggregation.PART_OUT, NAME="corridor2")  # -> PART_OUT, MASK; inputs PART: list, NAME: list; plug-in component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
namefilter_3 = Wasp_FilterPartsByName(PART=fieldaggregation.PART_OUT, NAME="corridor3")  # -> PART_OUT, MASK; inputs PART: list, NAME: list; plug-in component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
namefilter_4 = Wasp_FilterPartsByName(PART=fieldaggregation.PART_OUT, NAME="corridor4")  # -> PART_OUT, MASK; inputs PART: list, NAME: list; plug-in component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
namefilter_5 = Wasp_FilterPartsByName(PART=fieldaggregation.PART_OUT, NAME="elevator")  # -> PART_OUT, MASK; inputs PART: list, NAME: list; plug-in component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
namefilter_6 = Wasp_FilterPartsByName(PART=fieldaggregation.PART_OUT, NAME="lab")  # -> PART_OUT, MASK; inputs PART: list, NAME: list; plug-in component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
namefilter_7 = Wasp_FilterPartsByName(PART=fieldaggregation.PART_OUT, NAME="ramp")  # -> PART_OUT, MASK; inputs PART: list, NAME: list; plug-in component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
namefilter_8 = Wasp_FilterPartsByName(PART=fieldaggregation.PART_OUT, NAME="office")  # -> PART_OUT, MASK; inputs PART: list, NAME: list; plug-in component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
namefilter_9 = Wasp_FilterPartsByName(PART=fieldaggregation.PART_OUT, NAME="aprmnt")  # -> PART_OUT, MASK; inputs PART: list, NAME: list; plug-in component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
getattr = Wasp_GetAttributeByName(PART=namefilter.PART_OUT, ID="railing")  # -> VAL; plug-in component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
partgeo = Wasp_GetPartGeometry(PART=namefilter.PART_OUT)  # -> GEO; plug-in component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
getattr_2 = Wasp_GetAttributeByName(PART=namefilter.PART_OUT, ID="arches")  # -> VAL; plug-in component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
partgeo_2 = Wasp_GetPartGeometry(PART=namefilter_3.PART_OUT)  # -> GEO; plug-in component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
getattr_3 = Wasp_GetAttributeByName(PART=namefilter.PART_OUT, ID="floor")  # -> VAL; plug-in component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
getattr_4 = Wasp_GetAttributeByName(PART=namefilter_2.PART_OUT, ID="railing")  # -> VAL; plug-in component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
getattr_5 = Wasp_GetAttributeByName(PART=namefilter_2.PART_OUT, ID="arches")  # -> VAL; plug-in component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
partgeo_3 = Wasp_GetPartGeometry(PART=namefilter_2.PART_OUT)  # -> GEO; plug-in component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
getattr_6 = Wasp_GetAttributeByName(PART=namefilter_3.PART_OUT, ID="floor")  # -> VAL; plug-in component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
getattr_7 = Wasp_GetAttributeByName(PART=namefilter_2.PART_OUT, ID="floor")  # -> VAL; plug-in component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
getattr_8 = Wasp_GetAttributeByName(PART=namefilter_4.PART_OUT, ID="railing")  # -> VAL; plug-in component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
partgeo_4 = Wasp_GetPartGeometry(PART=namefilter_4.PART_OUT)  # -> GEO; plug-in component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
getattr_9 = Wasp_GetAttributeByName(PART=namefilter_4.PART_OUT, ID="arches")  # -> VAL; plug-in component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
getattr_10 = Wasp_GetAttributeByName(PART=namefilter_4.PART_OUT, ID="floor")  # -> VAL; plug-in component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
getattr_11 = Wasp_GetAttributeByName(PART=namefilter_5.PART_OUT, ID="railing")  # -> VAL; plug-in component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
getattr_12 = Wasp_GetAttributeByName(PART=namefilter_5.PART_OUT, ID="arches")  # -> VAL; plug-in component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
getattr_13 = Wasp_GetAttributeByName(PART=namefilter_5.PART_OUT, ID="floor")  # -> VAL; plug-in component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
getattr_14 = Wasp_GetAttributeByName(PART=namefilter_5.PART_OUT, ID="glass")  # -> VAL; plug-in component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
partgeo_5 = Wasp_GetPartGeometry(PART=namefilter_5.PART_OUT)  # -> GEO; plug-in component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
getattr_15 = Wasp_GetAttributeByName(PART=namefilter_6.PART_OUT, ID="body")  # -> VAL; plug-in component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
getattr_16 = Wasp_GetAttributeByName(PART=namefilter_6.PART_OUT, ID="arches")  # -> VAL; plug-in component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
getattr_17 = Wasp_GetAttributeByName(PART=namefilter_6.PART_OUT, ID="glass")  # -> VAL; plug-in component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
partgeo_6 = Wasp_GetPartGeometry(PART=namefilter_6.PART_OUT)  # -> GEO; plug-in component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
partgeo_7 = Wasp_GetPartGeometry(PART=namefilter_7.PART_OUT)  # -> GEO; plug-in component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
getattr_18 = Wasp_GetAttributeByName(PART=namefilter_7.PART_OUT, ID="railing")  # -> VAL; plug-in component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
getattr_19 = Wasp_GetAttributeByName(PART=namefilter_7.PART_OUT, ID="arches")  # -> VAL; plug-in component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
getattr_20 = Wasp_GetAttributeByName(PART=namefilter_7.PART_OUT, ID="floor")  # -> VAL; plug-in component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
getattr_21 = Wasp_GetAttributeByName(PART=namefilter_8.PART_OUT, ID="body")  # -> VAL; plug-in component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
getattr_22 = Wasp_GetAttributeByName(PART=namefilter_8.PART_OUT, ID="arches")  # -> VAL; plug-in component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
getattr_23 = Wasp_GetAttributeByName(PART=namefilter_8.PART_OUT, ID="glass")  # -> VAL; plug-in component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
partgeo_8 = Wasp_GetPartGeometry(PART=namefilter_8.PART_OUT)  # -> GEO; plug-in component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
getattr_24 = Wasp_GetAttributeByName(PART=namefilter_8.PART_OUT, ID="floor")  # -> VAL; plug-in component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
partgeo_9 = Wasp_GetPartGeometry(PART=namefilter_9.PART_OUT)  # -> GEO; plug-in component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
getattr_25 = Wasp_GetAttributeByName(PART=namefilter_8.PART_OUT, ID="railing")  # -> VAL; plug-in component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
getattr_26 = Wasp_GetAttributeByName(PART=namefilter_9.PART_OUT, ID="railing")  # -> VAL; plug-in component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
getattr_27 = Wasp_GetAttributeByName(PART=namefilter_9.PART_OUT, ID="body")  # -> VAL; plug-in component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
getattr_28 = Wasp_GetAttributeByName(PART=namefilter_9.PART_OUT, ID="arches")  # -> VAL; plug-in component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
getattr_29 = Wasp_GetAttributeByName(PART=namefilter_9.PART_OUT, ID="glass")  # -> VAL; plug-in component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
body = Merge(Data1=getattr_15, Data2=getattr_27, Data3=getattr_21)
glass = Merge(Data1=getattr_14, Data2=getattr_29, Data3=getattr_23)
arches = Merge(
    Data1=getattr_2,
    Data2=getattr_5,
    Data4=getattr_9,
    Data5=getattr_12,
    Data6=getattr_19,
    Data7=getattr_16,
    Data8=getattr_28,
    Data9=getattr_22,
    Data10=getattr_17)
floor = Merge(
    Data1=getattr_3,
    Data2=getattr_7,
    Data3=getattr_6,
    Data4=getattr_10,
    Data5=getattr_13,
    Data6=getattr_20,
    Data7=getattr_24)
railing = Merge(Data1=getattr, Data2=getattr_4, Data4=getattr_8, Data5=getattr_11, Data6=getattr_18, Data7=getattr_26, Data8=getattr_25)
mesh = Mesh(body)
mesh_2 = Mesh(arches)
mesh_3 = Mesh(glass)
mesh_4 = Mesh(floor)
clean_tree = CleanTree(RemoveNulls=True, RemoveInvalid=True, RemoveEmpty=True, Tree=flatten(mesh))
mesh_5 = Mesh(railing)

colour_cmyk = ColourCMYK(Cyan=Slider(0, range=0..1), Magenta=Slider(0.1, range=0..1), Yellow=Slider(1, range=0..1), Key=Slider(0, range=0..1))

colour_cmyk_2 = ColourCMYK(Cyan=Slider(0, range=0..1), Magenta=Slider(1, range=0..1), Yellow=Slider(0.6, range=0..1), Key=Slider(0, range=0..1))

clean_tree_2 = CleanTree(RemoveNulls=True, RemoveInvalid=True, RemoveEmpty=True, Tree=flatten(mesh_5))

colour_cmyk_3 = ColourCMYK(Cyan=Slider(0, range=0..1), Magenta=Slider(0.4, range=0..1), Yellow=Slider(0.6, range=0..1), Key=Slider(0, range=0..1))

clean_tree_3 = CleanTree(RemoveNulls=True, RemoveInvalid=True, RemoveEmpty=True, Tree=flatten(mesh_4))
clean_tree_4 = CleanTree(RemoveNulls=True, RemoveInvalid=True, RemoveEmpty=True, Tree=flatten(mesh_2))

colour_cmyk_4 = ColourCMYK(Cyan=Slider(0.8, range=0..1), Magenta=Slider(0.1, range=0..1), Yellow=Slider(0, range=0..1), Key=Slider(0, range=0..1))

clean_tree_5 = CleanTree(RemoveNulls=True, RemoveInvalid=True, RemoveEmpty=True, Tree=flatten(mesh_3))

colour_cmyk_5 = ColourCMYK(Cyan=Slider(0.5, range=0..1), Magenta=Slider(1, range=0..1), Yellow=Slider(0, range=0..1), Key=Slider(0, range=0..1))

clean_tree_6 = CleanTree(RemoveNulls=True, RemoveInvalid=True, RemoveEmpty=True, Tree=flatten(clean_tree))
deconstruct_mesh = DeconstructMesh(Mesh=clean_tree_2)  # -> Vertices, Faces, Colours, Normals
deconstruct_mesh_2 = DeconstructMesh(Mesh=clean_tree_3)  # -> Vertices, Faces, Colours, Normals
deconstruct_mesh_3 = DeconstructMesh(Mesh=clean_tree_4)  # -> Vertices, Faces, Colours, Normals
deconstruct_mesh_4 = DeconstructMesh(Mesh=clean_tree_5)  # -> Vertices, Faces, Colours, Normals
deconstruct_mesh_5 = DeconstructMesh(Mesh=clean_tree_6)  # -> Vertices, Faces, Colours, Normals
construct_mesh = ConstructMesh(Vertices=deconstruct_mesh.Vertices, Faces=deconstruct_mesh.Faces, Colours=colour_cmyk)
construct_mesh_2 = ConstructMesh(Vertices=deconstruct_mesh_2.Vertices, Faces=deconstruct_mesh_2.Faces, Colours=colour_cmyk_3)
construct_mesh_3 = ConstructMesh(Vertices=deconstruct_mesh_3.Vertices, Faces=deconstruct_mesh_3.Faces, Colours=colour_cmyk_2)
construct_mesh_4 = ConstructMesh(Vertices=deconstruct_mesh_4.Vertices, Faces=deconstruct_mesh_4.Faces, Colours=colour_cmyk_4)
construct_mesh_5 = ConstructMesh(Vertices=deconstruct_mesh_5.Vertices, Faces=deconstruct_mesh_5.Faces, Colours=colour_cmyk_5)

# ---- group: RH_OUT:railing
geometry_10 = Geometry(construct_mesh)

# ---- group: RH_OUT:arches
geometry_11 = Geometry(construct_mesh_3)

# ---- group: RH_OUT:floor
geometry_12 = Geometry(construct_mesh_2)

# ---- group: RH_OUT:glass
geometry_13 = Geometry(construct_mesh_4)

# ---- group: RH_OUT:body
geometry_14 = Geometry(construct_mesh_5)
